% Simulink data dictionary API_integrated_CR2006b.sldd

EnumAEBS_FCWState = enum(DefaultValue="AEBS_FCWState_StandBy", StorageType="uint8")
  AEBS_FCWState_StandBy = 0
  AEBS_FCWState_Level1Actived = 1
  AEBS_FCWState_Level2Actived = 2
  AEBS_FCWState_Level3Actived = 3
  AEBS_FCWState_Level4Actived = 4
  AEBS_FCWState_Level5Actived = 5

EnumDCSN_change_lane_reason = enum(DefaultValue="LC_NO_REQUEST", StorageType="uint8")
  LC_NO_REQUEST = 0
  LC_USER_CMD = 1
  LC_NAVIGATION_CMD = 2
  LC_FRONT_OBSTACLE = 3

EnumDCSN_driving_direction = enum(DefaultValue="FORWARD", StorageType="uint8")
  FORWARD = 0
  LEFT = 1
  RIGHT = 2

EnumDCSN_inlane_nudge_reason = enum(DefaultValue="NUDGE_NO_REQUEST", StorageType="uint8")
  NUDGE_NO_REQUEST = 0
  NUDGE_FRONT_OBSTACLE = 1
  NUDGE_SIDE_OBSTACLE = 2  % Lateral shift to keep safe lateral distance from dangerous obstacles

EnumDCSN_pull_over_reason = enum(DefaultValue="PULLOVER_NO_REQUEST", StorageType="uint8")
  PULLOVER_NO_REQUEST = 0
  PULLOVER_USER_CMD = 1
  PULLOVER_POLICE = 2
  PULLOVER_SYSTEM_FAULT = 3

EnumLCCS_ValidLane = enum(DefaultValue="LCCS_NoLane", StorageType="uint8")
  LCCS_NoLane = 0
  LCCS_LeftLane = 1
  LCCS_RightLane = 2
  LCCS_BothLane = 3

Vector2f = Simulink.Bus()
  x: single  % position_covariance of x
  y: single  % position covariance of y

Vector3d = Simulink.Bus()
  x: double, Unit="m"
  y: double, Unit="m"
  z: double, Unit="m"

Vector3f = Simulink.Bus()
  x: single
  y: single
  z: single

EGMO_Motion = Simulink.Bus()
  velocity_utm: Bus: Vector3f  % unit in m/s
  linear_velocity: single, Unit="m/s"  % scalar linear velocity with direction based on the gravity point movement
  roll_rate_utm: single, Unit="rad/s"
  pitch_rate_utm: single, Unit="rad/s"
  yaw_rate_utm: single, Unit="rad/s"
  yaw_rate_road: single, Unit="rad/s"  % yaw rate from vehicle CAN
  yaw_rate_road_covariance: single, Unit="rad"  % yaw rate covariance from vehicle CAN
  acceleration_utm: Bus: Vector3f  % unit in m/s2
  linear_acceleration: single, Unit="m/s2"
  steer_angle_filtered: single, Unit="rad"  % steering wheel angle after filtering
  curvature: single, Unit="1/m"  % instantaneous curvature of the ego vehicle
  velocity_rel: Bus: Vector2f  % unit in m/s
  velocity_rel_covariance: Bus: Vector2f  % unit in m/s
  slip_angle: single, Unit="rad"  % the angle between the direction of velocity and the direction which vehicle body faces, unit in rad
  acceleration_rel: Bus: Vector2f  % unit in m/s2
  acceleration_rel_covariance: Bus: Vector2f  % unit in m/s2
  turn_indicator: int8  % 0 = UNKNOWN
    % 1 = NONE
    % 2 = LEFT
    % 3 = RIGHT
    % 4 = EMERGENCY
  padding: int8[7]  % padding for communication data alignment, DO NOT USE

EGMO_DataBus = Simulink.Bus()
  timestamp_high: int32, Unit="us"
  timestamp_low: uint32, Unit="us"
  time_utc_high: int32, Unit="us"  % Coordinated universal time
  time_utc_low: uint32, Unit="us"
  is_ready: boolean  % EgoMotion validity bit
  padding: int8[7]  % padding for communication data alignment, DO NOT USE
  pose_utm: Bus: EGMO_Pose
  motion: Bus: EGMO_Motion

MPFU_Pose = Simulink.Bus()  % unit in meter
  is_valid: boolean
  padding: int8[7]
  position: Bus: Vector3d, Unit="m"
  roll: single, Unit="rad"  % range = (-pi, pi]
  pitch: single, Unit="rad"  % range = (-pi, pi]
  yaw: single, Unit="rad"  % range = (-pi, pi]
  heading: single, Unit="rad"  % range = (-pi, pi]

MPFU_Curvature = Simulink.Bus()
  is_valid: boolean
  padding: int8[3]
  value: single

MPFU_Road = Simulink.Bus()
  id: int8  % road id convention:
    % 0 - EGO_ROAD   本车所在的road
    % 1 - PREV_ROAD    前接road
    % 2 - NEXT_ROAD    后继road
  type: int8  % 0- UNKNOWN
    % 1- REGULAR
    % 2- OVERPASS
    % 3- HIGHWAY
    % 4- TUNNEL
    % 5- CITY_EXPRESS
    % 6- reserved
    % 7- reserved
    % 8- reserved
  direction: int8  % 0- UNKNOWN
    % 1- SAME_DIR
    % 2- OPPOSITE_DIR
  road_edge_indices: uint8[8]
  num_road_edges: uint8
  lane_indices: uint8[8]
  num_lanes: uint8
  padding: int8[3]

MPFU_LaneMarker = Simulink.Bus()
  id: int8  % Fused Lane ID:
    % 0- INVALID
    % 1- LEFT_FIRST_LANEMARK
    % 2- RIGHT_FIRST_LANEMARK
    % 3- LEFT_SECOND_LANEMARK
    % 4- RIGHT_SECOND_LANEMARK
    % 5- LEFT_THIRD_LANEMARK
    % 6- RIGHT_THIRD_LANEMARK
    % 7- LEFT_FOURTH_LANEMARK
    % 8- RIGHT_FOURTH_LANEMARK
  fusion_status: int8  % 0 - no vision and no hdmap
    % 1 - only vision
    % 2 - only hdmap
    % 3 - vision hdmap fused
    % 4 - vision hdmap object fused
  type: int8  % UNKNOWN=0;
    % SINGLE_DOTTED_LINE=1;
    % SHORT_DOTTED_LINE=2;
    % SHORT_THICK_DOTTED_LINE=3;
    % DOUBLE_DOTTED_LINE=4;
    % SINGLE_SOLID_LINE=5;
    % DOUBLE_SOLID_LINE=6;
    % LEFT_DOTTED_RIGHT_SOLID=7;
    % LEFT_SOLID_RIGHT_DOTTED=8;
  color: int8  % UNKNOWN = 0;
    % WHITE = 1;
    % YELLOW = 2;
    % BLUE = 3;
    % GREEN = 4;
    % RED = 5;
  quality: uint8  % confidence level = [0,100]
  padding_1: int8[3]
  c0_position: single
  c1_heading: single
  c2_curvature: single
  c3_curvature_derivative: single
  start_rel: Bus: Vector2f
  end_rel: Bus: Vector2f
  distance_to_host: single, Unit="m"  % Distance from EGO origin point (center of rear axle) to the lane marker
  padding_2: int8[4]

MPFU_TrafficLight = Simulink.Bus()
  fusion_status: int8  % 0 - no vision and no hdmap
    % 1 - only vision
    % 2 - only hdmap
    % 3 - vision hdmap fused
    % 4 - vision hdmap object fused
  lane_index: uint8
  type: int8  % 0-UKNOWN
    % 1-ROUND
    % 2-LEFT_TURN_ARROW
    % 3-RIGHT_TURN_ARROW
    % 4-FORWARD_ARROW
    % 5-X_SHAPE
    % 6-RECTANGLE
    % 7-PEDESTRIAN
    % 8-BICYCLE
    % 9-VECHCLE
  layout: int8  % 0- UNKNOWN
    % 1- HORIZONTAL
    % 2- VERTICAL
  state: int8  % 0- UNKNOWN
    % 1- RED
    % 2- YELLOW
    % 3- GREEN
    % 4- RED_FLASH
    % 5- YELLOW_FLASH
  padding_1: int8[3]  % padding for communication data alignment, DO NOT USE
  position_rel: Bus: Vector2f
  count_down_time: int8, Unit="s"
  padding_2: int8[7]  % padding for communication data alignment, DO NOT USE

MPFU_StopLine = Simulink.Bus()
  fusion_status: int8  % 0 - no vision and no hdmap
    % 1 - only vision
    % 2 - only hdmap
    % 3 - vision hdmap fused
    % 4 - vision hdmap object fused
  lane_index: uint8
  padding: int8[2]
  position_s: single, Unit="m"  % accumulated distance in SL coordinates
  start_rel: Bus: Vector2f
  end_rel: Bus: Vector2f

MPFU_Junction = Simulink.Bus()
  fusion_status: int8  % 0 - no vision and no hdmap
    % 1 - only vision
    % 2 - only hdmap
    % 3 - vision hdmap fused
    % 4 - vision hdmap object fused
  shape: int8  % 0- UNKNOWN
    % 1- CROSSROADS
    % 2- T_SHAPE_JUNCTION
    % 3- ROUNDABOUT
    % 4- RAMP
    % 5- JUNCTION_WITH_TRAFFIC_LIGHTS
    % 6- MULTI_ROAD_JUNCTION
    % 7- OTHERS
  type: int8  % 0-UNKNOWN
    % 1-HIGHWAY_AND_HIGHWAY
    % 2-HIGHWAY_AND_REGULAR
    % 3- REGULAR_AND_REGULAR
  padding_1: int8
  vertices_rel: Bus: Vector2f[16]
  num_vertices: uint8
  padding_2: int8[3]  % padding for communication data alignment, DO NOT USE

OBFU_DataBus = Simulink.Bus()
  timestamp_high: int32, Unit="us"
  timestamp_low: uint32, Unit="us"
  obstacles: Bus: OBFU_Obstacle[128]
  num_obstacles: uint16
  padding: int8[6]  % padding for communication data alignment, DO NOT USE

MPFU_DataBus = Simulink.Bus()
  timestamp_high: int32, Unit="us"
  timestamp_low: uint32, Unit="us"
  is_ready: boolean  % MapFusion validity bit
  padding_1: int8[7]  % padding for communication data alignment, DO NOT USE
  pose_utm: Bus: MPFU_Pose
  curvature: Bus: MPFU_Curvature
  roads: Bus: MPFU_Road[4]
  num_roads: uint8
  padding_2: int8[7]  % padding for communication data alignment, DO NOT USE
  road_edges: Bus: MPFU_RoadEdge[8]
  num_road_edges: uint8
  padding_3: int8[7]
  lanes: Bus: MPFU_Lane[8]
  num_lanes: uint8
  padding_4: int8[7]
  lane_markers: Bus: MPFU_LaneMarker[16]
  num_lane_markers: uint8
  padding_5: int8[7]  % padding for communication data alignment, DO NOT USE
  traffic_lights: Bus: MPFU_TrafficLight[16]
  num_traffic_lights: uint8
  padding_6: int8[7]  % padding for communication data alignment, DO NOT USE
  traffic_signs: Bus: MPFU_TrafficSign[16]
  num_traffic_signs: uint8
  padding_7: int8[7]  % padding for communication data alignment, DO NOT USE
  stop_lines: Bus: MPFU_StopLine[4]
  num_stop_lines: uint8
  padding_8: int8[7]  % padding for communication data alignment, DO NOT USE
  cross_walks: Bus: MPFU_Crosswalk[4]
  num_cross_walks: uint8
  padding_9: int8[7]  % padding for communication data alignment, DO NOT USE
  junctions: Bus: MPFU_Junction[8]
  num_junctions: uint8
  padding_10: int8[7]  % padding for communication data alignment, DO NOT USE

MPFU_Lane = Simulink.Bus()
  id: int8  % 0 - EGO_LANE
    % 1 - LEFT_FIRST_LANE
    % 2 - RIGHT_FIRST_LANE
    % 3 - LEFT_SECOND_LANE
    % 4 - RIGHT_SECOND_LANE
    % 5 - LEFT_THIRD_LANE
    % 6 - RIGHT_THIRD_LANE
  fusion_status: int8  % 0 - no vision and no hdmap
    % 1 - only vision
    % 2 - only hdmap
    % 3 - vision hdmap fused
    % 4 - vision hdmap object fused
  num_prev_lanes: uint8
  prev_lane_indices: uint8[8]  % predecessor lane IDs, there could be more than one
  num_succ_lanes: uint8
  succ_lane_indices: uint8[8]  % predecessor lane id, there could be more than one
  speed_limit_max: uint8, Unit="km/h"
  speed_limit_min: uint8, Unit="km/h"
  padding_1: int8[2]  % padding for communication data alignment, DO NOT USE
  width: single  % Lane width: the average value of the staring and ending wdith
  length: single  % total length of the lane
  type: int8  % 0- UNKNOWN
    % 1- REGULAR_LANE
    % 2- OFF_RAMP
    % 3- ON_RAMP
    % 4- CONNECT_RAMP
    % 5- EMERGENCY_LANE
    % 6- OTHERS
    % 7- RESERVED
  turn_type: int8  % 0 - UNKNOWN
    % 1 - ONLY_FORWARD
    % 2 - ONLY_LEFT_TURN
    % 3 - ONLY_RIGHT_TURN
    % 4 - FORWARD_LEFT_TURN
    % 5 - FORWARD_RIGHT_TURN
    % 6 - LEFT_RIGHT_TURN
    % 7 - U_TURN
    % 8 - NO_U_TURN
    % 9 - NO_LEFT_TURN
    % 10 - NO_RIGHT_TURN
    % 11 - NO_LEFT_RIGHT_TURN
    % 12 - RESERVED
    % 13 - RESERVED
    % 14 - RESERVED
  direction: int8  % 0- UNKNOWN
    % 1- SAME_DIRECTION
    % 2- OPPOSITE_DIRECTION
  road_index: uint8
  left_lane_marker_index: int8  % -1 for none-exist
  right_lane_marker_index: int8  % -1 for none-exist
  padding_2: int8[2]  % padding for communication data alignment, DO NOT USE

EGMO_Pose = Simulink.Bus()
  position: Bus: Vector3d  % UTM coordinates (x,y,z)
  position_quality: uint8
  padding: int8[3]  % padding for communication data alignment, DO NOT USE
  position_covariance: Bus: Vector2f
  roll: single, Unit="rad"  % roll in UTM coorindates
    % range = (-pi, pi)
  pitch: single, Unit="rad"  % pitch in UTM coorindates
    % range = (-pi, pi)
  yaw: single, Unit="rad"  % yaw in UTM coorindates
    % range = (-pi, pi)
  yaw_covariance: single
  heading: single, Unit="rad"  % same as yaw in UTM coordinates

VsACCS_DataBus = Simulink.Signal(StorageClass="ImportedExtern", DataType="Bus: ACCS_DataBus")
VsAEBS_DataBus = Simulink.Signal(StorageClass="ImportedExtern", DataType="Bus: AEBS_DataBus")
VsARBT_DataBus = Simulink.Signal(StorageClass="ImportedExtern", DataType="Bus: ARBT_DataBus")
VsDCSN_DataBus = Simulink.Signal(StorageClass="ImportedExtern", DataType="Bus: DCSN_DataBus")
VsEGMO_DataBus = Simulink.Signal(StorageClass="ImportedExtern", DataType="Bus: EGMO_DataBus")
VsLCCS_DataBus = Simulink.Signal(StorageClass="ImportedExtern", DataType="Bus: LCCS_DataBus")
VsLDWS_DataBus = Simulink.Signal(StorageClass="ImportedExtern", DataType="Bus: LDWS_DataBus")
VsMPFU_DataBus = Simulink.Signal(StorageClass="ImportedExtern", DataType="Bus: MPFU_DataBus")
VsOBFU_DataBus = Simulink.Signal(StorageClass="ImportedExtern", DataType="Bus: OBFU_DataBus")
VsCOMM_FAW_ADCU_TX_Data = Simulink.Signal(StorageClass="ImportedExtern", DataType="Bus: COMM_ADCU_TX_Data")
VsCOMM_FAW_VEH_RX_Data = Simulink.Signal(StorageClass="ImportedExtern", DataType="Bus: COMM_VEH_RX_Data")

OBFU_Obstacle = Simulink.Bus()
  id: int32
  nearest_point_rel: Bus: Vector3f, Unit="m"
  center_point_rel: Bus: Vector3f, Unit="m"
  heading_rel: single, Unit="rad"
  velocity_rel: Bus: Vector2f, Unit="m/s"
  acceleration_rel: Bus: Vector2f, Unit="m/s2"
  is_velocity_valid: boolean
  is_acceleration_valid: boolean
  padding_1: int8[2]  % padding for communication data alignment, DO NOT USE
  length: single, Unit="m"
  width: single, Unit="m"
  height: single
  polygon_points: Bus: Vector3f[8]
  num_polygon_points: uint8
  padding_2: int8[3]  % padding for communication data alignment, DO NOT USE
  tracking_time: int32, Unit="s"
  type: int8  % UNKNOWN=0;
    % PEDESTRIAN=1;
    % BICYCLE=2;
    % MOTORCYCLE = 3;
    % VEHICLE=4;
    % BUS=5;
    % TRUCK=6;
    % ANIMAL =7;
    % TRAFFIC_CONE = 8;
    % FENCES = 9;
  motion_status: int8  % 0 = UNKNOWN
    % 1 = MOVING
    % 2 = STATIONARY
    % 3 = STOPPED
  motion_orientation: int8  % 0 = UNKNOWN
    % 1 = ONCOMING
    % 2 = CROSSING_LEFT
    % 3 = CROSSING_RIGHT
    % 4 = PRECEDING
  confidence: uint8, Min=0, Max=100  % Confideng level between 0-100
  position_zone: int8  % UNKNOWN = 0,
    % FRONT_LEFT = 1,
    % FRONT = 2,
    % FRONT_RIGHT = 3,
    % LEFT = 4,
    % RIGHT = 5,
    % REAR_LEFT = 6,
    % REAR = 7,
    % REAR_LEFT = 8,
  turn_indicator: int8  % 0 = UNKNOWN
    % 1 = NONE
    % 2 = LEFT
    % 3 = RIGHT
    % 4 = EMERGENCY
  brake_indicator: int8  % 0 = UNKNOWN
    % 1 = OFF
    % 2 = ON
  tracking_status: int8  % 0 = INVALID
    % 1 = CREATE
    % 2 = UPDATE_NEW
    % 3 = UPDATE
    % 4 = UPDATE_STABLE
    % 5 = PREDICT_NEW
    % 6 = PREDICT
  source: uint16  % Obstacle source (sensor1 | sensor2 | ..)
    % LIDAR = first bit;
    % Radar = second bit;
    % CMAERA = third bit;
    % V2X = fourth bit;
    % 5-16 bit reserved
  is_cipv_front: boolean  % is cipv (closest in-path vehicle) in the FRONT position
  is_cipv_rear: boolean  % is cipv (closest in-path vehicle) in the REAR position
  is_cipv_left: boolean  % is cipv (closest in-path vehicle) in the LEFT position
  is_cipv_right: boolean  % is cipv (closest in-path vehicle) in the RIGHT position
  is_cutin: boolean  % is a cut-in obstacle
  is_cutout: boolean  % is a cut-out obstacle

MPFU_Crosswalk = Simulink.Bus()
  fusion_status: int8  % 0 - no vision and no hdmap
    % 1 - only vision
    % 2 - only hdmap
    % 3 - vision hdmap fused
    % 4 - vision hdmap object fused
  quality: uint8  % 置信度 = [0,100]
  padding_1: int8[2]  % padding for communication data alignment, DO NOT USE
  points: Bus: Vector2f[16]
  num_vertices: uint8
  padding_2: int8[3]  % padding for communication data alignment, DO NOT USE

EnumLDWS_la_detec_st = enum(DefaultValue="LDWS_BothAvl", StorageType="uint8")  % 0=LDWS_NotAAvl;
  % 1=LDWS_LeAvl;
  % 2=LDWS_RiAvl;
  % 3=LDWS_BothAvl;
  LDWS_BothAvl = 3
  LDWS_LeAvl = 1
  LDWS_RiAvl = 2
  LDWS_NotAvl = 0

EnumLDWS_on_state_st = enum(DefaultValue="LDWS_Enabling", StorageType="uint8")
  LDWS_Enabling = 0
  LDWS_Standby = 1
  LDWS_Active = 2
  LDWS_Passive = 3

EnumLDWS_system_st = enum(DefaultValue="LDWS_Off", StorageType="uint8")
  LDWS_Off = 0
  LDWS_On = 1
  LDWS_Error = 2

EnumLDWS_warn_side = enum(DefaultValue="LDWS_NoWarn", StorageType="uint8")  % 0=LDWS_NoWarn;
  % 1=LDWS_WarnLe;
  % 2=LDWS_WarnRi;
  LDWS_WarnLe = 1
  LDWS_WarnRi = 2
  LDWS_NoWarn = 0

EnumLDWS_wrn_mgr_st = enum(DefaultValue="Avl", StorageType="uint8")  % 0=NotAvl;
  % 1=Avl;
  % 2=WarnLe;
  % 3=WarnRi;
  % 4=SuppLe;
  % 5=SuppRi;
  Avl = 1
  NotAvl = 0
  WarnLe = 2
  WarnRi = 3
  SuppLe = 4
  SuppRi = 5

LDWS_DataBus = Simulink.Bus()
  LDWS_la_detect_st: Enum: EnumLDWS_la_detec_st
  LDWS_warn_side: Enum: EnumLDWS_warn_side
  LDWS_warn_st: boolean
  LDWS_system_st: Enum: EnumLDWS_system_st
  LDWS_on_state_st: Enum: EnumLDWS_on_state_st

EnumDCSN_adm_hmi_msg_display = enum(DefaultValue="NO_MSG", StorageType="uint8")  % 0 = NO_MSG
  % 1 = ACTIVE
  % 2 = OVRD
  % 3 = TAKEOVER_REQ
  % 4 = FAULT
  NO_MSG = 0
  ACTIVE = 1
  OVRD = 2
  TAKEOVER_REQ = 3
  FAULT = 4

EnumDCSN_adm_hmi_icon_display = enum(DefaultValue="NO_ICON", StorageType="uint8")  % 0 = NO_ICON
  % 1 = GREY_SOLID
  % 2 = GREEN_SOLID
  % 3 = BLUE_SOLID
  % 4 = RED_FLASH_SLOW
  % 5 = RED_FLASH_FAST
  % 6 = RED_SOLID
  NO_ICON = 0
  GREY_SOLID = 1
  GREEN_SOLID = 2
  BLUE_SOLID = 3
  RED_FLASH_SLOW = 4
  RED_FLASH_FAST = 5
  RED_SOLID = 6

COMM_ADCU_TX_Data = Simulink.Bus()
  T01: Bus: COMM_ADCU_TX_T01
  T02: Bus: COMM_ADCU_TX_T02
  T03: Bus: COMM_ADCU_TX_T03
  T05: Bus: COMM_ADCU_TX_T05
  T08: Bus: COMM_ADCU_TX_T08
  T13: Bus: COMM_ADCU_TX_T13
  T15: Bus: COMM_ADCU_TX_T15
  T16: Bus: COMM_ADCU_TX_T16

COMM_ADCU_TX_T01 = Simulink.Bus()
  ADV_Status: uint8
  Target_Speed: single
  Brake_Switch: uint8
  XBR_External_Acc_Demand: single

COMM_ADCU_TX_T02 = Simulink.Bus()
  Transmission_Requested_Gear: int16

COMM_ADCU_TX_T03 = Simulink.Bus()
  Override_Control_Mode: uint8
  Override_Control_Mode_Priority: uint8
  Requested_Torque_Torque_Limit: int16
  Message_Counter: uint8
  Message_Checksum: uint8

COMM_ADCU_TX_T05 = Simulink.Bus()
  XBR1_External_Accleration_Demand: single
  XBR1_EBI_Mode: uint8
  XBR1_Priority: uint8
  XBR1_Control_Mode: uint8
  XBR1_Message_Counter: uint8
  XBR1_Message_Checksum: uint8

COMM_ADCU_TX_T08 = Simulink.Bus()
  ReAX_Desired_operation_mode: uint8
  ReAX_Command_from_ext_controller: single
  ReAX_Message_counter: uint8
  ReAX_Message_Checksum: uint8

COMM_ADCU_TX_T13 = Simulink.Bus()
  EPB_Control_mode: uint8
  EPB_Control_Command: uint8
  EPB_Message_Counter: uint8
  EPB_Message_Checksum: uint8

COMM_ADCU_TX_T15 = Simulink.Bus()
  Running_Light_Command: uint8
  Low_Beam_Head_Light_Command: uint8
  High_Beam_Light_Command: uint8
  Tractor_Front_Fog_Lights_Command: uint8
  Right_Turn_Signal_Lights_Command: uint8
  Left_Turn_Signal_Lights_Command: uint8
  Alarm_Horn_Command: uint8
  Implement_Marker_Light_Command: uint8
  Rear_Fog_Light_Command: uint8

COMM_ADCU_TX_T16 = Simulink.Bus()
  Wiper_switch_control_command: uint8
  Washing_switch_control_command: uint8
  BCM_control_by_ADV_state: uint8
  Rear_brake_switch_control: uint8
  Horn_control_command: uint8

COMM_VEH_RX_Data = Simulink.Bus()
  R01: Bus: COMM_VEH_RX_R01
  R02: Bus: COMM_VEH_RX_R02
  R03: Bus: COMM_VEH_RX_R03
  R07: Bus: COMM_VEH_RX_R07
  R08: Bus: COMM_VEH_RX_R08
  R09: Bus: COMM_VEH_RX_R09
  R10: Bus: COMM_VEH_RX_R10
  R11: Bus: COMM_VEH_RX_R11
  R12: Bus: COMM_VEH_RX_R12
  R13: Bus: COMM_VEH_RX_R13
  R14: Bus: COMM_VEH_RX_R14
  R15: Bus: COMM_VEH_RX_R15
  R16: Bus: COMM_VEH_RX_R16
  R17: Bus: COMM_VEH_RX_R17
  R19: Bus: COMM_VEH_RX_R19
  R20: Bus: COMM_VEH_RX_R20
  R21: Bus: COMM_VEH_RX_R21
  R25: Bus: COMM_VEH_RX_R25
  R27: Bus: COMM_VEH_RX_R27
  R28: Bus: COMM_VEH_RX_R28
  R29: Bus: COMM_VEH_RX_R29
  R30: Bus: COMM_VEH_RX_R30
  R32: Bus: COMM_VEH_RX_R32
  R33: Bus: COMM_VEH_RX_R33
  R34: Bus: COMM_VEH_RX_R34
  R35: Bus: COMM_VEH_RX_R35
  R39: Bus: COMM_VEH_RX_R39
  R40: Bus: COMM_VEH_RX_R40

COMM_VEH_RX_R01 = Simulink.Bus()
  VCU_Mode: uint8
  Manual_Brake_Switch: uint8
  Manual_Accelerator_Pedal: single
  Auto_To_Manual_Tips: uint16

COMM_VEH_RX_R02 = Simulink.Bus()
  Nominal_friction_percent_torque: int16

COMM_VEH_RX_R03 = Simulink.Bus()
  Engine_Oil_Pressure: uint16

COMM_VEH_RX_R07 = Simulink.Bus()
  Engine_coolant_temperature: int16

COMM_VEH_RX_R08 = Simulink.Bus()
  Catalyst_Tank_Level: single

COMM_VEH_RX_R09 = Simulink.Bus()
  Output_Shaft_Speed: single
  Input_Shaft_Speed: single

COMM_VEH_RX_R10 = Simulink.Bus()
  Actual_Gear_Ratio: single
  Current_Gear: int16

COMM_VEH_RX_R11 = Simulink.Bus()
  Engine_Coolant_Level_Low_Lamp: uint8

COMM_VEH_RX_R12 = Simulink.Bus()
  Ser_Brake_Circuit_1_Air_Pressure: uint16
  Ser_Brake_Circuit_2_Air_Pressure: uint16

COMM_VEH_RX_R13 = Simulink.Bus()
  Engine_torque_mode: uint8
  Driver_demand_percent_torque: int16
  Actua_engine_percent_torque: int16
  Engine_Speed: single

COMM_VEH_RX_R14 = Simulink.Bus()
  Parking_Brake_Switch: uint8
  Wheel_based_vehicle_speed: single
  Brake_Switch: uint8

COMM_VEH_RX_R15 = Simulink.Bus()
  High_Resolu_TotalVehDistance: single

COMM_VEH_RX_R16 = Simulink.Bus()
  ABS_active: uint8
  EBS_Brake_Switch: uint8
  Brake_Pedal_Position: single
  EBS_Red_Warning_Signal: uint8
  ABS_EBSAmberWarningSig: uint8

COMM_VEH_RX_R17 = Simulink.Bus()
  Front_Axle_Speed: single
  Relative_Speed_FA_Leftwheel: single
  Relative_Speed_RA_RightWheel: single
  Relative_Speed_RA1_Leftwheel: single
  Relative_Speed_RA1_Rightwheel: single
  Relative_Speed_RA2_Leftwheel: single
  Relative_Speed_RA2_Rightwheel: single

COMM_VEH_RX_R19 = Simulink.Bus()
  Steer_Wheel_Angle: single
  Yaw_Rate: single
  Lateral_Accerleration: single
  Longitudinal_Acceleration: single

COMM_VEH_RX_R20 = Simulink.Bus()
  Column_Torque: single
  Coulmn_Velocity: single
  Pull_Compensation: single
  Column_Torque_QF: boolean
  Column_Velocity_QF: boolean
  Ignition_State: boolean
  Hands_off_Detected: boolean
  Hands_on_Detcted: boolean
  Column_Message_Checksum: uint8
  Column_Message_Counter: uint8

COMM_VEH_RX_R21 = Simulink.Bus()
  Absolute_Steering_Position: single
  External_Input_Command_Echo: single
  Status_Error: uint8
  Actual_Mode: uint8
  Request_Mode: uint8
  Absolute_Steering_Position_QF: boolean
  Steer_Message_Checksum: uint8
  Steer_Message_counter: uint8

COMM_VEH_RX_R25 = Simulink.Bus()
  EPB_Working_Mode: uint8
  Autohold_Working_Status: uint8
  EPB_Driverless_mode: uint8

COMM_VEH_RX_R27 = Simulink.Bus()
  Tractor_Front_Fog_LightsCommand: uint8
  Rear_Fog_Light_Command: uint8

COMM_VEH_RX_R28 = Simulink.Bus()
  Veh_running_state: uint8
  Low_beam_light_state: uint8
  High_beam_light_state: uint8
  Right_turnning_light_state: uint8
  Left_turnning_light_state: uint8
  Reversing_light_and_alarm_horn: uint8
  Position_lamp_state: uint8

COMM_VEH_RX_R29 = Simulink.Bus()
  BCM_response_status: uint8
  Rear_brake_lamp_status: uint8
  Horn_command_status: uint8

COMM_VEH_RX_R30 = Simulink.Bus()
  Front_Operator_Wiper_Switch: uint8
  Front_Operator_Washer_Switch: uint8

COMM_VEH_RX_R32 = Simulink.Bus()
  Tire_Location: uint8
  Tire_pressure: uint16
  Tire_Temperature: single
  Tire_Status: uint8
  Extended_Tire_Pressure_Support: uint8
  Tire_Air_Leakage_Rate: single
  Tire_Pressure_Thresh_Detection: uint8

COMM_VEH_RX_R33 = Simulink.Bus()
  Tire_Location: int8
  Tire_Pressure_Extended_Range: uint16
  Required_Tire_Pressure: uint16

COMM_VEH_RX_R34 = Simulink.Bus()
  Open_Status_of_Door_1_Driver: uint8
  OpenStatus_of_Door_2_Passenger: uint8

COMM_VEH_RX_R35 = Simulink.Bus()
  Fuel_Level_1: single

COMM_VEH_RX_R39 = Simulink.Bus()
  ADV_Function_Switch_1: uint8
  ADV_Function_Switch_2: uint8

COMM_VEH_RX_R40 = Simulink.Bus()
  Axle_Location: uint8
  Axle_Weight: single

ACCS_DataBus = Simulink.Bus()
  VbACCS_ExitStandbyToOn: boolean
  VbACCS_InformDriverPressGasPedal: boolean
  VbACCS_InformDriverPressResume: boolean
  VeACCS_EnterStandbyState: Enum: EnumACCS_StandbyType
  VfACCS_Lon_Accleration: single
  VbACCS_Lon_Torq_req: boolean
  VfACCS_Lon_Torq: single
  VfACCS_Lon_Speed_Tar: single
  VfACCS_Lon_Range_Act: single
  VbACCS_Lon_Accleration_req: boolean
  VeACCS_Mode: Enum: EnumACCS_Mode
  VeACCS_RunStatus: Enum: EnumACCS_RunStatus

AEBS_AEB_Data = Simulink.Bus()
  AEB_request: boolean
  AEB_prebrake_req: boolean
  AEB_acceleration_req: single
  AEB_brakeLight_req: boolean
  AEB_enabled_state: Enum: EnumAEBS_EnblState
  AEB_actived_state: Enum: EnumAEBS_AEBState
  AEB_error: uint8

AEBS_FCW_Data = Simulink.Bus()
  FCW_request: boolean
  FCW_warn_level: uint8
  FCW_enable_state: Enum: EnumAEBS_EnblState
  FCW_active_state: Enum: EnumAEBS_FCWState
  FCW_error: uint8

MPFU_TrafficSign = Simulink.Bus()
  fusion_status: int8  % 0 - no vision and no hdmap
    % 1 - only vision
    % 2 - only hdmap
    % 3 - vision hdmap fused
    % 4 - vision hdmap object fused
  type: int8  % UNKNOWN = 0;
    % SPEED_LIMIT = 1;
    % STOP_SIGN = 2;
    % RESERVED1 = 3;
    % RESERVED2 = 4;
    % RESERVED3 = 5;
    % OTHER = 6;
  lane_index: uint8
  padding_1: int8  % padding for communication data alignment, DO NOT USE
  value: int32, Unit="m/s"
  position_s: single, Unit="m"  % accumulated distance in SL coordinates
  position_rel: Bus: Vector2f
  padding_2: int8[4]

EnumDCSN_stop_reason = enum(DefaultValue="NO_STOP_REQUEST", StorageType="uint8")  % 0 = NO_STOP_REQUEST
  % 1 = STOP_FOR_DESTINATION
  % 2 = STOP_FOR_TRAFFIC_LIGHT
  % 3 = STOP_FOR_STOP_LINE
  % 4 = STOP_FOR_STOP_SIGN
  % 5 = STOP_FOR_CROSSWALK
  % 6 = STOP_FOR_KEEP_CLEAR
  NO_STOP_REQUEST = 0
  STOP_FOR_DESTINATION = 1
  STOP_FOR_TRAFFIC_LIGHT = 2
  STOP_FOR_STOP_LINE = 3
  STOP_FOR_STOP_SIGN = 4
  STOP_FOR_CROSSWALK = 5
  STOP_FOR_KEEP_CLEAR = 6

EnumDCSN_adm_main_mode = enum(DefaultValue="ADM_OFF", StorageType="uint8")  % 0 = ADM_OFF
  % 1 = ADM_STANDBY
  % 2 = ADM_READY
  % 3 = ADM_ACTIVE
  % 4 = ADM_STEER_OVRD
  % 5 = ADM_TAKEOVER_WARNING
  % 6 = ADM_FAULT_WARNING
  % 7 = ADM_FAULT_REACTION
  % 8 = ADM_FAULT_DETECTED
  ADM_OFF = 0
  ADM_STANDBY = 1
  ADM_READY = 2
  ADM_ACTIVE = 3
  ADM_STEER_OVRD = 4
  ADM_TAKEOVER_WARNING = 5
  ADM_FAULT_WARNING = 6
  ADM_FAULT_REACTION = 7
  ADM_FAULT_DETECTED = 8

EnumDCSN_stop_request_mode = enum(DefaultValue="NotEnabled", StorageType="uint8")  % 0 NotEnabled
  % 1 WaitForValidStopLine
  % 2 CheckStopCond
  % 3 SendStopReqMpfuDis
  % 4 UpdateStopDis
  % 5 HoldForStopLineUpdate
  NotEnabled = 0
  WaitForValidStopLine = 1
  CheckStopCond = 2
  SendStopReqMpfuDis = 3
  UpdateStopDis = 4
  HoldForStopLineUpdate = 5

EnumDCSN_autodrive_control_mode = enum(DefaultValue="AUTODRIVE_PASIV", StorageType="uint8")  % 0 = AUTODRIVE_PASIV
  % 1 = AUTODRIVE_DELAY
  % 2 = AUTODRIVE_RE_ACTIV
  % 3 = AUTODRIVE_ACTIVATING
  % 4 = AUTODRIVE_ACTIVATED
  AUTODRIVE_PASIV = 0
  AUTODRIVE_DELAY = 1
  AUTODRIVE_RE_ACTIV = 2
  AUTODRIVE_ACTIVATING = 3
  AUTODRIVE_ACTIVATED = 4

COMM_Bus_VEH_Config = Simulink.Bus()
  VfCOMM_VEH_MinTurnRadius: single, Min=0, Max=30, Unit="m"  % Minimum turning radius
  VfCOMM_VEH_AngOrigin2FrontWheel: single, Min=-3.14, Max=3.14, Unit="rad"  % This is the angle between origin to front axle and origin to front wheel
  VfCOMM_VEH_YawInertia_Z: single, Min=0, Max=100000, Unit="kg*m2"  % Moment of inertia of the whole vehicle around z axis
  VfCOMM_VEH_DisOrigin2FrontWheel: single, Min=0, Max=10000, Unit="mm"  % This is the distance between the cordinate and the front wheel
  VfCOMM_VEH_DisOrigin2End: single, Min=0, Max=10000, Unit="mm"  % This is the distance between the cordinate origin and the rear surface
  VfCOMM_VEH_DisOrigin2RearAxle: single, Min=0, Max=10000, Unit="mm"  % This is the distance between the cordinate origin and the rear axle
  VfCOMM_VEH_DisOrigin2Head: single, Min=0, Max=10000, Unit="mm"  % This is the distance between the coordinate origin and the front surface
  VfCOMM_VEH_Width: single, Min=0, Max=5000, Unit="mm"  % Vehicle's width
  VfACCS_VEH_WheelDiameter: single, Min=0, Max=2000, Unit="mm"  % This is whell diameter
  VfCOMM_VEH_Length: single, Min=0, Max=20000, Unit="mm"  % This is vehicle length
  VfCOMM_VEH_StiffnessRear: single, Min=0, Max=1000000, Unit="N/deg"  % This is cornering stiffness of rear wheel
  VfCOMM_VEH_StiffnessFront: single, Min=0, Max=1000000, Unit="N/deg"  % This is cornering stiffness of front wheel
  VfCOMM_VEH_DisLeft2Right: single, Min=0, Max=5000, Unit="mm"  % This is the distance between left wheel and right wheel
  VfCOMM_VEH_DisCentorid2Front: single, Min=0, Max=10000, Unit="mm"  % This is the distance between Cetroid and Front surface
  VfCOMM_VEH_Mass: single, Min=0, Max=100000, Unit="kg"  % Vehicle mass
  VfCOMM_VEH_DisFront2Rear: single, Min=0, Max=10000, Unit="mm"  % This is distance between two axes

VsCOMM_VEH_Config = Simulink.Signal(StorageClass="ImportedExtern", DataType="Bus: COMM_Bus_VEH_Config")

ARBT_AccessoryGroup = Simulink.Bus()
  epb_ctrl_enbl_to_comm: boolean
  epb_switch_request: boolean
  epb_control_mode: uint8
  gear_ctrl_enbl_to_comm: boolean
  gear_ctrl_req: uint8
  auto_hold_req: boolean
  horn_ctrl_req: boolean  % request to activate the horn
    % 1 = horn on
    % 0 = horn off

ARBT_BrakeGroup = Simulink.Bus()
  brake_req_lon_a: single, Unit="m/s2"
  brake_ctrl_enbl_to_comm: boolean
  brake_precharge_req: boolean
  brake_priority_setting: boolean

ARBT_DataBus = Simulink.Bus()
  BrakeGroup: Bus: ARBT_BrakeGroup
  SteerGroup: Bus: ARBT_SteerGroup
  PowerGroup: Bus: ARBT_PowerGroup
  WarningGroup: Bus: ARBT_WarningGroup
  AccessoryGroup: Bus: ARBT_AccessoryGroup
  RecTrigFlagGroup: Bus: ARBT_RecTrigFlagGroup

ARBT_PowerGroup = Simulink.Bus()
  power_req_mode: uint8  % 0 = acceleration (def)
    % 1 = torque
  power_req_lon_a: single, Unit="m/s2"
  power_req_torque: single, Unit="Nm"
  power_ctrl_enbl_to_comm: boolean

ARBT_RecTrigFlagGroup = Simulink.Bus()
  missed_aeb_flag: boolean
  false_aeb_flag: boolean
  driver_hard_braking_flag: boolean
  aeb_triggered_flag: boolean

ARBT_SteerGroup = Simulink.Bus()
  steer_req_mode: uint8  % 0 = steering wheel angle
    % 1 = steering wheel torque
  steer_req_strwhl_angle: single, Unit="deg"
  steer_req_strwhl_torque: single, Unit="Nm"
  steer_ctrl_enbl_to_comm: boolean

ARBT_WarningGroup = Simulink.Bus()
  warn_haptic_req: boolean
  warn_acoustic_req: boolean
  warn_visual_lcw_left_req: boolean
  warn_visual_lcw_right_req: boolean
  warn_visual_ldw_left_req: boolean
  warn_visual_ldw_right_req: boolean
  warn_visual_fcw_req: boolean

VsALCA_DataBus = Simulink.Signal(StorageClass="ImportedExtern", DataType="Bus: ALCA_DataBus")

AEBS_DataBus = Simulink.Bus()
  FCW_Data: Bus: AEBS_FCW_Data
  AEB_Data: Bus: AEBS_AEB_Data
  AEBS_brake_priority_setting: boolean
  AEBS_horn_ctrl_req: boolean
  AEBS_obj_ID: int32

EnumLKAS_IntvSide = enum(DefaultValue="LKAS_IntvSideLe", StorageType="uint8")
  LKAS_NoIntvSide = 0
  LKAS_IntvSideLe = 1
  LKAS_IntvSideRi = 2

LKAS_DataBus = Simulink.Bus()
  Intv_Request: boolean
  SteerData: single
  IntvTyp_sLKA: Enum: EnumLKAS_IntvTyp
  IntvSide_sLKA: Enum: EnumLKAS_IntvSide
  IntvMgrSt_sLKA: Enum: EnumLKAS_IntvMgrSt

VsLKAS_DataBus = Simulink.Signal(StorageClass="ImportedExtern", DataType="Bus: LKAS_DataBus")

LCCS_DataBus = Simulink.Bus()  % LCCS databus.
  LCC_ReadyToEngage: boolean  % Lane centering control is ready to engage.
  LCC_ForceToDisengage: boolean  % Lane centering control is forced to disengage due to one of following reasons:
    % 1. EGMO and MPFU timestamp don't match.
    % 2. No valid lane marker.
  steering_control_engaged: boolean  % Steering control has reached fully engaged state at least one time in this autodrive cycle.
  valid_lane_marker: Enum: EnumLCCS_ValidLane  % Valid Lane Marker information. NoLane = 0, LeftLane = 1, RightLane = 2, BothLane = 3.
  veh_strwhl_angle_des: single, Unit="deg"  % Desired steering wheel angle in degree.
  lateral_dist_to_go: single, Unit="m"  % Lateral distance from shifted lane center to target lane center.

EnumDCSN_change_lane_cancel_reason = enum(DefaultValue="LC_CANCEL_NO_REQUEST", StorageType="uint8")  % 0 = LC_CANCEL_NO_REQUEST
  % 1 = LC_CANCEL_USR_CMD
  LC_CANCEL_NO_REQUEST = 0
  LC_CANCEL_USR_CMD = 1

DCSN_DataBus = Simulink.Bus()
  ADM_Group: Bus: DCSN_ADMGroup
  EnablingFlags_Group: Bus: DCSN_EnablingFlagsGroup
  TrafficDecider_Group: Bus: DCSN_TrafficDeciderGroup

EnumARBT_arbitration_winner = enum(DefaultValue="ARBT_NO_REQ", StorageType="uint8")  % ARBT_NO_REQ = 0
  % AEB = 1
  % ACC = 2
  % LCC = 3
  % ALCA = 4
  % BRAKE_OVRD = 5
  % RSVD2 = 6
  ARBT_NO_REQ = 0
  AEB = 1
  ACC = 2
  LCC = 3
  LKA = 4
  BRAKE_OVRD = 5
  RSVD2 = 6

DRIV_OverrideSteerData = Simulink.Bus()
  VbDIRV_Override_Steering: boolean
  VeDRIV_LeftChangeLane: Enum: EnumDRIV_LeftChangeLane
  VeDRIV_RightChangeLane: Enum: EnumDRIV_RightChangeLane
  VbDRIV_LaneKeepAssist: boolean

DRIV_OverrideButtonData = Simulink.Bus()
  VbDRIV_EnableAutoDrive: boolean
  VbLCC_ButtonActivate: boolean
  VbACC_ButtonActivate: boolean

EnumDRIV_DriverStatus = enum(DefaultValue="DRIV_DriverDozeoff", StorageType="uint8")
  DRIV_DriverDozeoff = 0
  DRIV_DriverSquint = 1
  DRIV_DriverSmoke = 2
  DRIV_DriverPlayPhone = 3
  DRIV_DriverNormal = 4

EnumLKAS_IntvMgrSt = enum(DefaultValue="LKAS_NoIntv", StorageType="uint8")
  LKAS_NoIntv = 0
  LKAS_Intv = 1
  LKAS_abort = 2
  LKAS_Completed = 3

EnumLKAS_IntvTyp = enum(DefaultValue="LKAS_SftyLaneKeepAid", StorageType="uint8")
  LKAS_NoIntvTyp = 0
  LKAS_SftyLaneKeepAid = 1

EnumDRIV_LeftChangeLane = enum(DefaultValue="LeftLC_NOT", StorageType="uint8")
  LeftLC_NOT = 0
  LeftLC_Ready = 1
  LeftLC_Ing = 2
  LeftLC_Finish = 3

EnumDRIV_RightChangeLane = enum(DefaultValue="RightLC_NOT", StorageType="uint8")
  RightLC_NOT = 0
  RightLC_Ready = 1
  RightLC_Ing = 2
  RightLC_Finish = 3

EnumAEBS_AEBState = enum(DefaultValue="AEBS_AEBState_StandBy", StorageType="uint8")
  AEBS_AEBState_StandBy = 0
  AEBS_AEBState_PreBrakeActived = 1
  AEBS_AEBState_PartialBrakeActived = 2
  AEBS_AEBState_FullBrakeActived = 3
  AEBS_AEBState_ConfidenceConfirmed = 4
  AEBS_AEBState_WaitForEPB = 5
  AEBS_AEBState_WaitForDealy = 6

EnumAEBS_EnblState = enum(DefaultValue="AEBS_EnblState_OFF", StorageType="uint8")
  AEBS_EnblState_OFF = 0
  AEBS_EnblState_ON = 1
  AEBS_AEBState_Fault = 2

EnumACCS_Mode = enum(DefaultValue="ACCS_mode_off", StorageType="uint8")  % 0:ACCS_mode_off
  % 1:ACCS_mode_on
  % 2:ACCS_mode_standby
  % 3:ACCS_mode_fault
  ACCS_mode_off = 0
  ACCS_mode_on = 1
  ACCS_mode_standby = 2
  ACCS_mode_fault = 3

EnumACCS_RunStatus = enum(DefaultValue="ACCS_status_off", StorageType="uint8")  % 0:ACCS_status_off
  % 1:ACCS_status_Standby
  % 2:ACCS_status_on
  % 3:ACCS_status_SpeedCtrl
  % 4:ACCS_status_FollowingCtrl
  % 5:ACCS_status_LowSpeed
  % 6:ACCS_status_TempStop
  % 7:ACCS_status_Stop
  % 8:ACCS_status_Launch
  % 9:ACCS_status_Fault
  ACCS_status_off = 0
  ACCS_status_Standby = 1
  ACCS_status_on = 2
  ACCS_status_SpeedCtrl = 3
  ACCS_status_FollowingCtrl = 4
  ACCS_status_LowSpeed = 5
  ACCS_status_TempStop = 6
  ACCS_status_Stop = 7
  ACCS_status_Launch = 8
  ACCS_status_Fault = 9

EnumACCS_StandbyType = enum(DefaultValue="NoEnterStandby", StorageType="uint8")  % 0:NoEnterStandby
  % 1:FromModeOffToStandby
  % 2:FromSpeedCtrlToStandby
  % 3:FromFollowingCtrlToStandby
  % 4:FromLowSpeedToStandby
  % 5:FromTempStopToStandby
  % 6:FromStopToStandby
  % 7:FromLaunchToStandby
  % 8:FromFaultToStandby
  % 9:DriverGasPedalOverride
  % 10:PressCancelSwitch
  NoEnterStandby = 0
  FromModeOffToStandby = 1
  FromSpeedCtrlToStandby = 2
  FromFollowingCtrlToStandby = 3
  FromLowSpeedToStandby = 4
  FromTempStopToStandby = 5
  FromStopToStandby = 6
  FromLaunchToStandby = 7
  FromFaultToStandby = 8
  DriverGasPedalOverride = 9
  PressCancelSwitch = 10

EnumALCA_fault_type = enum(DefaultValue="ALCA_fault_type_MPFU_notReceived", StorageType="uint8")  % 1:ALCA_fault_type_EGMO_notReceived
  % 2:ALCA_fault_type_MPFU_notReceived
  % 4:ALCA_fault_type_OBFU_notReceived
  % 8:ALCA_fault_type_CAN_notReceived
  ALCA_fault_type_EGMO_notReceived = 1
  ALCA_fault_type_MPFU_notReceived = 2
  ALCA_fault_type_OBFU_notReceived = 4
  ALCA_fault_type_CAN_notReceived = 8

EnumALCA_inform_reason = enum(DefaultValue="EnumALCA_inform_reason_accident_ahead", StorageType="uint8")  % 0: EnumALCA_inform_reason_no
  % 1: EnumALCA_inform_reason_low_cipv
  % 2: EnumALCA_inform_reason_accident_ahead
  EnumALCA_inform_reason_no = 0
  EnumALCA_inform_reason_low_cipv = 1
  EnumALCA_inform_reason_accident_ahead = 2

EnumALCA_interrupt_type = enum(DefaultValue="ALCA_interrupt_type_no", StorageType="uint8")  % 0: ALCA_interrupt_type_no
  % 1: ALCA_interrupt_type_driver_cancel
  ALCA_interrupt_type_no = 0
  ALCA_interrupt_type_driver_cancel = 1
  ALCA_interrupt_type_has_obstacle = 2

EnumALCA_not_fulfill_reason = enum(DefaultValue="ALCA_not_fulfill_reason_no_request", StorageType="uint8")  % 0: ALCA_not_fulfill_reason_no_request
  % 1: ALCA_not_fulfill_reason_no_lane
  % 2: ALCA_not_fulfill_reason_mpfu_reject
  % 3: ALCA_not_fulfill_reason_has_obstacle
  % 4: ALCA_not_fulfill_reason_low_speed
  % 5: ALCA_not_fulfill_reason_high_speed
  % 6: ALCA_not_fulfill_reason_dangerous_conditions
  % 7: ALCA_not_fulfill_reason_system_error
  % 8: ALCA_not_fulfill_reason_too_often
  % 9: ALCA_not_fulfill_reason_check_fulfilled
  ALCA_not_fulfill_reason_no_request = 0
  ALCA_not_fulfill_reason_no_lane = 1
  ALCA_not_fulfill_reason_mpfu_reject = 2
  ALCA_not_fulfill_reason_has_obstacle = 3
  ALCA_not_fulfill_reason_low_speed = 4
  ALCA_not_fulfill_reason_high_speed = 5
  ALCA_not_fulfill_reason_dangerous_conditions = 6
  ALCA_not_fulfill_reason_system_error = 7
  ALCA_not_fulfill_reason_too_often = 8
  ALCA_not_fulfill_reason_check_fulfilled = 9

EnumALCA_state = enum(DefaultValue="ALCA_state_OFF", StorageType="uint8")  % 0: ALCA_state_OFF
  % 1: ALCA_state_Standby
  % 2: ALCA_state_Activated
  % 3: ALCA_state_Waiting
  % 4: ALCA_state_Inform
  % 5: ALCA_state_Finish
  % 6: ALCA_state_Handover
  % 7: ALCA_state_Abort
  ALCA_state_OFF = 0
  ALCA_state_Standby = 1
  ALCA_state_Activated = 2
  ALCA_state_Waiting = 3
  ALCA_state_Inform = 4
  ALCA_state_Finish = 5
  ALCA_state_Handover = 6
  ALCA_state_Abort = 7

ALCA_DataBus = Simulink.Bus()
  state: Enum: EnumALCA_state  % ALCA state:
    % 0: ALCA_state_OFF
    % 1: ALCA_state_Standby
    % 2: ALCA_state_Activated
    % 3: ALCA_state_Waiting
    % 4: ALCA_state_Inform
    % 5: ALCA_state_Finish
    % 6: ALCA_state_Handover
    % 7: ALCA_state_Abort
  request: boolean  % Lane change request.
  request_side: Enum: EnumDCSN_driving_direction  % Request side:
    % 0: FORWARD
    % 1: LEFT
    % 2: RIGHT
  odd_not_fulfill_reason: Enum: EnumALCA_not_fulfill_reason  % not_fulfill reason:
    % 0: ALCA_not_fulfill_reason_no_request
    % 1: ALCA_not_fulfill_reason_no_lane
    % 2: ALCA_not_fulfill_reason_mpfu_reject
    % 3: ALCA_not_fulfill_reason_has_obstacle
    % 4: ALCA_not_fulfill_reason_low_speed
    % 5: ALCA_not_fulfill_reason_high_speed
    % 6: ALCA_not_fulfill_reason_dangerous_conditions
    % 7: ALCA_not_fulfill_reason_system_error
    % 8: ALCA_not_fulfill_reason_too_often
    % 9: ALCA_not_fulfill_reason_check_fulfilled
  fault: uint8  % bit1:ALCA_fault_type_EGMO_notReceived
    % bit2:ALCA_fault_type_MPFU_notReceived
    % bit3:ALCA_fault_type_OBFU_notReceived
    % bit4:ALCA_fault_type_CAN_notReceived
  interrupt: boolean  % ALCA has interrupt.
  interrupt_type: Enum: EnumALCA_interrupt_type  % Interrupt tupe:
    % 0: ALCA_interrupt_type_no
    % 1: ALCA_interrupt_type_driver_cancel
  inform_request: boolean  % Inform request, dispalay on hmi or ...
  inform_reason: Enum: EnumALCA_inform_reason  % 0: EnumALCA_inform_reason_no
    % 1: EnumALCA_inform_reason_low_cipv
    % 2: EnumALCA_inform_reason_accident_ahead
  inform_side: Enum: EnumDCSN_driving_direction  % Inform side:
    % 0: FORWARD
    % 1: LEFT
    % 2: RIGHT
  lateral_v: single, Unit="m/s"  % The laeral v for LCCS target line move.

BSDS_DataBus = Simulink.Bus()
  bswL_ID: int32
  bswR_ID: int32
  active_status: Enum: EnumBSDS_Active_Status
  left_warning_status: Enum: EnumBSDS_Warning_Status
  right_warning_status: Enum: EnumBSDS_Warning_Status

EnumBSDS_Active_Status = enum(DefaultValue="BSDS_NONE", StorageType="uint8")
  BSDS_NONE = 0
  BSDS_OFF = 1
  BSDS_INACTIVE = 2
  BSDS_ERROR = 3
  BSDS_ACTIVE = 4
  BSDS_SELF_CHECK = 5

EnumBSDS_Warning_Status = enum(DefaultValue="BSDS_NO_WARNING", StorageType="uint8")
  BSDS_NO_WARNING = 0
  BSDS_WARNING_LOW_LEVEL = 1
  BSDS_WARNING_HIGH_LEVEL = 2

EnumLCAS_Active_Status = enum(DefaultValue="LCAS_NONE", StorageType="uint8")
  LCAS_NONE = 0
  LCAS_OFF = 1
  LCAS_INACTIVE = 2
  LCAS_ERROR = 3
  LCAS_ACTIVE = 4
  LCAS_SELF_CHECK = 5

EnumLCAS_Warning_Status = enum(DefaultValue="LCAS_NO_WARNING", StorageType="uint8")
  LCAS_NO_WARNING = 0
  LCAS_WARNING_LOW_LEVEL = 1
  LCAS_WARNING_HIGH_LEVEL = 2

LCAS_DataBus = Simulink.Bus()
  cvwL_ID: int32
  cvwR_ID: int32
  active_status: Enum: EnumLCAS_Active_Status
  left_warning_status: Enum: EnumLCAS_Warning_Status
  right_warning_status: Enum: EnumLCAS_Warning_Status

VsLCAS_DataBus = Simulink.Signal(StorageClass="ImportedExtern", DataType="Bus: LCAS_DataBus")
VsBSDS_DataBus = Simulink.Signal(StorageClass="ImportedExtern", DataType="Bus: BSDS_DataBus")

DCSN_EnablingFlagsGroup = Simulink.Bus()
  power_ctrl_enable: boolean  % Enable flag for acceleration (gas pedal) control
  brake_ctrl_enable: boolean  % Enable flag for brake control
  steer_ctrl_enable: boolean  % Enable flag for steer control
  gear_ctrl_enable: boolean  % Enable flag for gear control
  epb_ctrl_enable: boolean  % Enable flag for electric parking brake control
  acc_feature_enable: boolean
  lcc_feature_enable: boolean
  alca_feature_enable: boolean
  aeb_feature_enable: boolean
  fcw_feature_enable: boolean
  lcw_feature_enable: boolean
  ldw_feature_enable: boolean
  lka_feature_enable: boolean  % Enable flag for LKA feature.
  bsd_feature_enable: boolean  % Enable flag for BSD feature.
  lca_feature_enable: boolean  % Enable flag for LCA feature.
  rcta_feature_enable: boolean  % Enable flag for RCTA feature.
  fcta_feature_enable: boolean  % Enable flag for FCTA feature.
  dow_feature_enable: boolean  % Enable flag for DOW feature.
  autodrive_control_mode: Enum: EnumDCSN_autodrive_control_mode  % 0 = AUTODRIVE_PASIV
    % 1 = AUTODRIVE_DELAY
    % 2 = AUTODRIVE_RE_ACTIV
    % 3 = AUTODRIVE_ACTIVATING
    % 4 = AUTODRIVE_ACTIVATED

DCSN_ADMGroup = Simulink.Bus()
  adm_main_mode: Enum: EnumDCSN_adm_main_mode  % 0 = ADM_OFF
    % 1 = ADM_STANDBY
    % 2 = ADM_READY
    % 3 = ADM_ACTIVE
    % 4 = ADM_STEER_OVRD
    % 5 = ADM_TAKEOVER_WARNING
    % 6 = ADM_FAULT_WARNING
    % 7 = ADM_FAULT_REACTION
    % 8 = ADM_FAULT_DETECTED
  adm_hmi_msg_display: Enum: EnumDCSN_adm_hmi_msg_display  % 0 = NO_MSG
    % 1 = ACTIVE
    % 2 = OVRD
    % 3 = TAKOVER_REQ
    % 4 = FAULT
  adm_hmi_icon_display: Enum: EnumDCSN_adm_hmi_icon_display  % 0 = NO_ICON
    % 1 = GREY_SOLID
    % 2 = GREEN_SOLID
    % 3 = BLUE_SOLID
    % 4 = RED_FLASH_SLOW
    % 5 = RED_FLASH_FAST
    % 6 = RED_SOLID
  usr_cmd_autodrive_activate: uint8  % 0 = Deactivate
    % 1 = Activate
    % 2 = Hold
  adm_accs_resume: boolean  % 0 = Not request resume
    % 1 = Request resume
  acoustic_warning_req: boolean

DCSN_TrafficDeciderGroup = Simulink.Bus()
  stop_request: boolean
  stop_s_distance: single, Unit="m"
  stop_reason: Enum: EnumDCSN_stop_reason  % 0 = NO_STOP_REQUEST
    % 1 = STOP_FOR_DESTINATION
    % 2 = STOP_FOR_TRAFFIC_LIGHT
    % 3 = STOP_FOR_STOP_LINE
    % 4 = STOP_FOR_STOP_SIGN
    % 5 = STOP_FOR_CROSSWALK
    % 6 = STOP_FOR_KEEP_CLEAR
  lane_speed_limit: single, Unit="m/s"  % The speed limit of ego lane
  target_speed_limit: single  % Target speed limit
  speed_limit_distance: single
  speed_limit_reason: Enum: EnumDCSN_speed_limit_reason  % 0 = NO_LIMIT
    % 1 = LIMIT_FOR_CROSSWALK
    % 2 = LIMIT_FOR_NUDGE
    % 3 = LIMIT_FOR_CURVATURE
  change_lane_request: boolean
  change_lane_req_side: Enum: EnumDCSN_driving_direction
  change_lane_reason: Enum: EnumDCSN_change_lane_reason
  change_lane_target_speed: single, Unit="m/s"
  change_lane_cancel_request: boolean
  change_lane_cancel_reason: Enum: EnumDCSN_change_lane_cancel_reason  % 0 = LC_CANCEL_NO_REQUEST
    % 1 = LC_CANCEL_USR_CMD
  inlane_nudge_request: boolean
  inlane_nudge_side: Enum: EnumDCSN_driving_direction  % 0 = FORWARD
    % 1 = LEFT
    % 2 = RIGHT
  inlane_nudge_reason: Enum: EnumDCSN_inlane_nudge_reason
  pull_over_request: boolean
  pull_over_reason: Enum: EnumDCSN_pull_over_reason
  over_speed_warning: boolean  % 0 = Vehicle speed in range
    % 1 = Vehicle speed is over the maximal allowed speed

EnumDCSN_speed_limit_reason = enum(DefaultValue="NO_LIMIT", StorageType="uint8")  % 0 = NO_LIMIT
  % 1 = LIMIT_FOR_CROSSWALK
  % 2 = LIMIT_FOR_NUDGE
  % 3 = LIMIT_FOR_CURVATURE
  NO_LIMIT = 0
  LIMIT_FOR_CROSSWALK = 1
  LIMIT_FOR_NUDGE = 2
  LIMIT_FOR_CURVATURE = 3

DRIV_DataBus = Simulink.Bus()
  OverrideSteer: Bus: DRIV_OverrideSteerData
  OverrideButton: Bus: DRIV_OverrideButtonData
  VeDRIV_DriverStatus: Enum: EnumDRIV_DriverStatus
  VbDRIV_ModeStatus: boolean
  DRIV_ACCS_Switch: Bus: DRIV_ACCS_Switch

DRIV_ACCS_Switch = Simulink.Bus()
  VbDRIV_ACCMainSwitch: boolean, Min=0, Max=1  % ACC main switch
  VbDRIV_ACCResumeSwitch: boolean, Min=0, Max=1  % Acc reusme switch
  VbDRIV_ACCCancelSwitch: boolean, Min=0, Max=0  % Acc cancel switch
  VfDRIV_ACCDriveSetSpeed: single, Min=0, Max=50, Unit="m/s"  % Driver set target speed
  VfDRIV_ACCTimeGap: uint8, Min=0, Max=8, Unit="s"  % Time gap

VsCOMM_CANR_Databus = Simulink.Signal(StorageClass="ImportedExtern", DataType="Bus: COMM_CANR_Databus")
VsCOMM_CANT_Databus = Simulink.Signal(StorageClass="ImportedExtern", DataType="Bus: COMM_CANT_Databus")
VsDRIV_DataBus = Simulink.Signal(StorageClass="ImportedExtern", DataType="Bus: DRIV_DataBus")

COMM_CANR_Databus = Simulink.Bus()  % Can Receive data bus
  COMM_RX_AutodriveMode: Bus: COMM_RX_AutodriveMode
  COMM_RX_BCM: Bus: COMM_RX_BCM
  COMM_RX_Brake: Bus: COMM_RX_Brake
  COMM_RX_Parking: Bus: COMM_RX_Parking
  COMM_RX_Power: Bus: COMM_RX_Power
  COMM_RX_Steering: Bus: COMM_RX_Steering
  COMM_RX_Transmission: Bus: COMM_RX_Transmission
  COMM_RX_VehicleDynamics: Bus: COMM_RX_VehicleDynamics

COMM_CANT_Databus = Simulink.Bus()  % Can Transmit data bus
  COMM_TX_AutodriveMode: Bus: COMM_TX_AutodriveMode
  COMM_TX_BCM: Bus: COMM_TX_BCM
  COMM_TX_Brake: Bus: COMM_TX_Brake
  COMM_TX_HMI: Bus: COMM_TX_HMI
  COMM_TX_Parking: Bus: COMM_TX_Parking
  COMM_TX_Power: Bus: COMM_TX_Power
  COMM_TX_Steering: Bus: COMM_TX_Steering
  COMM_TX_Transmission: Bus: COMM_TX_Transmission

COMM_RX_Parking = Simulink.Bus()  % Can Receive data about Parking
  EPB_AutoholdStatus: boolean  % Auto Park status
  EPB_ActualControlStatus: uint8  % EPB actual control status(0:Release)
  EPB_SystemFaultStatus: uint8  % EPB fault status(0:NoFault)
  EPB_ParkingControlResponse: boolean  % Whether the EPB Park control respond
  EPB_SwitchStatus: boolean  % EPB switch status

COMM_RX_Power = Simulink.Bus()  % Can Receive data about Power
  EMS_StartStopStatus: uint8  % 0-Reset Start/Stop not active(any engine condition possible)...
  EMS_EngineSpeedValid: boolean  % Invalid flag for EMS_EngineSpeedRPM
  VCU_VirtualAccelPedalPosition: single  % Signal from EMS to indicate ACCelerate pedal position
  VCU_VirtualAccelPedalValid: boolean  % EMS_AccelPedalPosition invalid flag
  VCU_AccelPedalOverride: boolean  % indicating the torque demanded by the driver is higher than the torque demanded by ESP-VLC.
  EMS_EngineState: uint8  % Engine status(0：KeyOff；1：ACC；2：KeyOn；3：Crank；4：Run)
  EMS_EngineSpeed: single  % Engine speed
  EMS_CoolantLevelLow: boolean  % Less cooling water
  PCU_PowerControlResponse: boolean  % Whether torque control respond
  PCU_DriverDemandTorque: single  % Driver's desired torque
  PCU_ActualEngineTorque: single  % Actual engine torque
  EMS_EngineOilPressure: uint16  % Oil pressure
  EMS_EngineCoolantTemperature: int16  % Engine cooling water temperature
  EMS_CatalystTankLevel: single  % Status of urea tank
  VCU_AccelPedalValid: boolean  % Accelerator pedal Valid
  VCU_TargetAccelPedalPostionEcho: single  % Acceleration request from adcu received by VCU
  VCU_ActualAccelPedalPosition: single  % Actual pedal opening degree
  PCU_PowertrainFaultLevel: uint8  % Power system fault level(0:NoFault)
  PCU_BatterySOC: single  % Power battery SOC
  PCU_MotorSpeed: single  % Motor speed
  PCU_MotorActualTorque: single  % Actual torque of motor
  PCU_EngineTorqueLoss: single  % Engine torque loss

COMM_RX_Steering = Simulink.Bus()  % Can Receive data about Steering
  EPS_SteeringWheelTorqueValid: boolean  % Validation bit of measured torsion bar torque.
  EPS_SteeringControlResponse_LDW: boolean  % EPS control status for LDW vibration
  EPS_SteeringControlResponse_LCC: boolean  % EPS control status for LKS
  EPS_SteeringModeEcho: uint8  % Target corner status received by EPS from ADCU（0：Driver；1：SteeringAngle；2：SteeringWheelTorque）
  EPS_SteeringControlResponse: boolean  % Whether the steering system respond
  EPS_TargetSteeringAngleEcho: single  % Target corner signal received by EPS from ADCU
  EPS_ActualSteeringAngle: single  % Actual steering wheel angle feedback
  EPS_SteeringAngleRate: single  % Steering wheel angle change rate
  EPS_FaultLevel: uint8  % Steering performance fault level(0:NoFault)
  EPS_SteeringWheelTorque: single  % Torque applied by the driver to the steering wheel
  EPS_HandsOffWheelDetected: boolean  % Driver hands off steering wheel
  EPS_HandsOnWheelDetected: boolean  % Driver's hand on steering wheel

COMM_RX_Transmission = Simulink.Bus()  % Can Receive data about Transmission
  TCU_TargetGearPositionEcho: uint8  % Target gear received by TCU from ADCU(0:Neutral;1-12:ForwardGears;13:Reverse;14Park;15:Invalid)
  TCU_ShiftLevelPosition: uint8  % Lever position (PRNDL)（0：Park;1:Reverse;2:Neutral;3:Drive）
  TCU_ActualGearPosition: uint8  % Actual gear (0:Neutral;1-12:ForwardGears;13:Reverse;14Park;15:Invalid)
  TCU_ActualGearRatio: single  % Actual gear ratio

COMM_RX_VehicleDynamics = Simulink.Bus()  % Can Receive data about VehicleDynamics
  VDC_YawRateValid: boolean  % Valid flag bit of yaw
  VDC_LongAccelerationValid: boolean  % Effective mark position of longitudinal acceleration
  VDC_LateralAccelerationValid: boolean  % Effective sign bit of lateral acceleration
  VDC_YawRate: single  % Yaw Rate from chassis
  VDC_VehicleSpeed: single  % Vehicle speed
  VDC_LongAcceleration: single  % Longitudinal acceleration
  VDC_LateralAcceleration: single  % Lateral acceleration
  VDC_WheelSpeed_RR1: single  % Right wheel speed of rear axle 1
  VDC_WheelSpeed_RR2: single  % Right wheel speed of rear axle 2
  VDC_WheelSpeed_RL1: single  % Left wheel speed of rear axle 1
  VDC_WheelSpeed_RL2: single  % Left wheel speed of rear axle 2
  VDC_WheelSpeed_FR: single  % Right front wheel speed
  VDC_WheelSpeed_FL: single  % Left front wheel speed
  VDC_WheelSpeed_RR1Valid: boolean  % Effective mark of right wheel speed of rear axle 1
  VDC_WheelSpeed_RR2Valid: boolean  % Effective mark of right wheel speed of rear axle 2
  VDC_WheelSpeed_RL1Valid: boolean  % Effective mark of left wheel speed of rear axle 1
  VDC_WheelSpeed_RL2Valid: boolean  % Effective mark of left wheel speed of rear axle 2
  VDC_WheelSpeed_FRValid: boolean  % Effective mark of right front wheel speed
  VDC_WheelSpeed_FLValid: boolean  % Effective mark of left front wheel speed
  VDC_WheelEncoderCounter_RL: uint32  % Left rear wheel encoder
  VDC_WheelEncoderCounter_RR: uint32  % Right rear wheel encoder

COMM_TX_AutodriveMode = Simulink.Bus()  % Can Transmit data for AutodriveMode Control
  ADCU_AutodriveEnable: boolean  % Automatic driving enable request

COMM_TX_BCM = Simulink.Bus()  % Can Transmit data for BCM Control
  ADCU_BCMControlEnable: boolean  % BCM control enable
  ADCU_BrakeLightRequest: boolean  % Brake light request
  ADCU_LowBeamRequest: boolean  % Low beam request
  ADCU_HighBeamRequest: boolean  % High beam request
  ADCU_LeftTurningLightRequest: boolean  % Left turn signal request
  ADCU_RightTurningLightRequest: boolean  % Right turn signal request
  ADCU_FrontFogLightRequest: boolean  % Front fog lamp request
  ADCU_BackFogLightRequest: boolean  % Rear fog lamp request
  ADCU_PositionLightRequest: boolean  % Marker lamp request
  ADCU_EmergencyLightRequest: boolean  % Double flash request
  ADCU_HornRequest: boolean  % Horn request
  ADCU_WiperControlRequest: uint8  % Wiper control request
  ADCU_WashingControlRequest: boolean  % Headlight cleaning control request

COMM_TX_Brake = Simulink.Bus()  % Can Transmit data for Brake Control
  ADCU_BrakeEnable: boolean  % Brake enable
  ADCU_BrakePressureValue: single  % It could be brake pressure or percentage
  ADCU_BrakeDecelValue: single  % Deceleration value (Usually negative)
  ADCU_BrakePrechargeRequest: boolean  % Brake system pre press request

COMM_TX_HMI = Simulink.Bus()  % Can Transmit data for HMI Control
  ADCU_TargetVehicleSpeed: single  % Target vehicle speed
  ADCU_SpeedUpIndicator: boolean  % Acceleration demand indicator（US Demo Only）
  ADCU_SpeedDownIndicator: boolean  % Deceleration demand indicator（US Demo Only）
  ADCU_OverSpeedWarning: boolean  % Overspeed alarm
  ADCU_FCW_Warning: uint8  % Forward collision warning

COMM_TX_Parking = Simulink.Bus()  % Can Transmit data for Parking Control
  ADCU_ParkingPressureRequest: boolean  % Pressure maintaining request
  ADCU_ParkingControlValue: uint8  % Parking control status(0:Release;1:Clamp)
  ADCU_ParkingControlEnable: boolean  % Parking control enable

COMM_TX_Power = Simulink.Bus()  % Can Transmit data for Power Control
  ADCU_PowerEnable: boolean  % Torque request enable
  ADCU_PowerTorqueValue: single  % Torque request value or percentage
  ADCU_PowerAccelValue: single  % Acceleration value
  ADCU_LaunchRequest: boolean  % Start request

COMM_TX_Steering = Simulink.Bus()  % Can Transmit data for Steering Control
  ADCU_SteeringTorqueEnable: boolean  % Steering wheel torque control enable
  ADCU_SteeringTorqueValue: single  % Steering wheel torque control value
  ADCU_SteeringAngleEnable: boolean  % Steering wheel angle enable
  ADCU_SteeringAngleValue: single  % Steering wheel angle value
  ADCU_SteeringAngleSpeed: single  % Steering wheel angle maximum speed

COMM_RX_AutodriveMode = Simulink.Bus()  % Can Receive data about AutodriveMode
  VCU_AutodriveMainSwitch: boolean  % Automatic driving master switch status (from driver)
  VCU_AutoToManualTips: uint16  % Reasons for not being able to enter automatic driving state：
    % Bit 1: comfort can bus off;
    % Bit 2: power can bus off:
    % Bit 3: adv control mode message timeout
    % Bit 4: adv torque request message CS / LS fault;
    % Bit 5: pull down the handbrake switch;
    % Bit 6: The Trailer hand brake switch is pulled down;
    % Bit 7: Cruise activation;
    % Bit 8: when the accelerator is depressed, it is greater than a certain threshold;
    % Bit 9: when the accelerator pedal fails;
    % Bit 10: the brake pedal is depressed;
    % Bit 11: brake pedal failure;
    % Bit 12: intelligent driving function shielding.
  VCU_AutodriveActiveStatus: boolean  % Whether automatic driving is activated as feedback from VCU

COMM_RX_BCM = Simulink.Bus()  % Can Receive data about BCM
  BCM_CruiseSwValid: boolean  % Indicate the cruise switch
  BCM_CruiseSwCancel: boolean  % BCM_CruiseSwCancel
  BCM_CruiseSwResume: boolean  % Cruise Resume Switch,Speed Up
  BCM_CruiseSwSet: boolean  % Cruise Set Switch,Speed Down
  BCM_CruiseSwTimeGapPlus: boolean  % To increase the TimeGapSet
  BCM_CruiseSwTimeGapMinus: boolean  % To decrease the TimeGapSet
  BCM_CruiseSwMain: boolean  % BCM_ACC MainSwitchStatus
  BCM_CruiseSwLimitMain: boolean  % BCM_LIMMainSwitchSts
  BCM_DriveMode: uint8  % BCM_DM_TargetModeReq（0：Normal；1：Sport；2：Eco；other：Reserve）
  BCM_DriverSeatBelt: boolean  % Signal from ACU for Driver seat belt warning indicator display on IPK
  BCM_DriverSeatBeltValid: boolean  % Signal from ACU for Driver seat belt warning  is valid
  BCM_CruiseControlStatus: uint8  % Cruise control status
  BCM_TurningLightEcho: boolean  % Turning signal request received from ADCU
  BCM_LowBeamSwitch: boolean  % Low beam status
  BCM_HighBeamSwitch: boolean  % High beam status
  BCM_BrakeLightStatus: boolean  % Brake light status
  BCM_LeftTurningLightState: boolean  % Left turning signal status
  BCM_RightTurningLightState: boolean  % Right turning signal status
  BCM_IgnitionKeyState: boolean  % Ignition key door status
  BCM_DriverDoorStatus: boolean  % Driver's door signal
  BCM_PassengerDoorStatus: boolean  % Copilot's door signal
  BCM_RearRightDoorStatus: boolean  % Right rear door signal
  BCM_RearLeftDoorStatus: boolean  % Left rear door signal
  BCM_FrontHoodStatus: boolean  % Signal of front hatch cover
  BCM_BackTrunkStatus: boolean  % Signal of trunk
  BCM_WiperSwitch: boolean  % Wiper Switch
  BCM_ControlResponse: boolean  % BCM controlled state

COMM_RX_Brake = Simulink.Bus()  % Can Receive data about Brake
  ESP_TCSActive: boolean  % Signal from TCS\ESC to indicate if TCS is activate or not
  ESP_ABSActive: boolean  % ABS active
  ESP_BrakeAirTankPressure: uint16  % Brake pressure (air circuit)
  VCU_BrakePedalValid: boolean  % Brake pedal effective
  ESP_BrakeControlResponse: boolean  % Whether ESP brake control responds
  VCU_TargetBrakePedalEcho: single  % Brake request received by VCU from ADCU
  VCU_ActualBrakePedalPosition: single  % Actual brake pedal position
  VCU_ActualBrakePedalSwitch: boolean  % Actual brake switch signal
  ESP_MasterCylinderPress: single  % Brake master cylinder pressure
  ESP_MasterCylinderPressValid: boolean  % Effective mark of brake master cylinder pressure
  ESP_SystemFaultStatus: uint8  % ESP system fault status(0:Normal)

COMM_TX_Transmission = Simulink.Bus()  % Can Transmit data for Transmission Control
  ADCU_TargetGearEnable: boolean  % Gear control enable
  ADCU_TargetGearValue: uint8  % Target gear(0:Neutral;1-12:ForwardGears;13:Reverse;14Park;15:Invalid)

MPFU_RoadEdge = Simulink.Bus()
  id: int8  % 路沿id
    % 0 - UNKNOWN   未知
    % 1-  LEFT_FIRST_ROAD_EDGE   主车左边第1根路沿
    % 2 - RIGHT_FIRST_ROAD_EDGE   主车右边第1根路沿
    % 3-  LEFT_SECOND_ROAD_EDGE    主车左边第2根路沿
    % 4 - RIGHT_SECOND_ROAD_EDGE    主车右边第2根路沿
    % 5-  LEFT_THIRD_ROAD_EDGE     主车左边第3根路沿
    % 6 - RIGHT_THIRD_ROAD_EDGE     主车右边第3根路沿
  fusion_status: int8  % 0 - no vision and no hdmap
    % 1 - only vision
    % 2 - only hdmap
    % 3 - vision hdmap fused
    % 4 - vision hdmap object fused
  type: int8  % 0- UNKNOWN
    % 1- LANE_MARK
    % 2- CURB_EDGE
    % 3- GUARDRAIL
    % 4- DITCH
    % 5- WALL
    % 6- NONE
  quality: uint8  % 置信度 = [0,100]
  c0_position: single
  c1_heading: single
  c2_curvature: single
  c3_curvature_derivative: single
  road_index: uint8  % 所属道路id
  padding_1: int8[3]
  start_rel: Bus: Vector2f
  end_rel: Bus: Vector2f
  distance_to_host: single, Unit="m"  % 本车所在后轴中心点到该路沿线的横向距离
  padding_2: int8[4]